# Grasshopper definition Catenary2.gh (Grasshopper 1.0.8)

mplane = MeshPlane(Boundary={Plane=PlaneXY(0, 0, 0), Size=Domain2(u=-10..10, v=-10..10)}, WidthCount=10, HeightCount=10)  # -> Mesh, Area
mc = MeshCorners(Mesh=mplane.Mesh, Angle=2.35619449)
edgelengths = EdgeLengths(Mesh=mplane.Mesh, LengthFactor=1, Strength=10)
vertexloads = VertexLoads(Mesh=mplane.Mesh, Strength=Slider(1, range=0.5..10))
reset = Button()
grab = Grab(On=True, Strength=1, Range=3)
anchor = Anchor(Point=mc, Strength=1000)
solver = Solver(GoalObjects=[anchor, edgelengths, vertexloads, grab], Reset=reset, Threshold=1e-15, Tolerance=0.01, On=True)  # -> I, V, O
data = Data(solver.O)
