# Grasshopper definition Catenary_slide.gh (Grasshopper 0.9.76)
# plug-ins: Kangaroo2 Components

W = WidthCount(20)
mplane = MeshPlane(Boundary={Plane=PlaneXY(0, 0, 0), Size=Domain2(u=-10..10, v=-10..10)}, WidthCount=W, HeightCount=W)  # -> Mesh, Area

# ---- group: here some vertices along the edges have been selected and fixed only in the Z direction, so they are free to slide on the XY plane
pt = Point([Point(10, 10, 0), Point(-10, 10, 0), Point(10, 9, 0), Point(-10, 9, 0), Point(10, 8, 0), Point(-10, 8, 0), Point(10, 7, 0), Point(-10, 7, 0), Point(10, 6, 0), Point(-10, 6, 0)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])
anchorxyz = AnchorXYZ(Point=pt, X="False", Y="False", Z="True", Strength=1000)

# ----
corners = Corners(mesh=mplane.Mesh)
vertexloads = VertexLoads(Mesh=mplane.Mesh, Strength=1)
edgelengths = EdgeLengths(Mesh=mplane.Mesh, LengthFactor=Slider(0.66, range=0..1), Strength=10)
anchor = Anchor(Point=corners, Strength=1000)
grab = Grab(On=True, Strength=1, Range=3)  # -> Grab, Anchors
reset = Button()
solver = Solver(
    GoalObjects=[anchor, grab.Grab, anchorxyz, edgelengths, vertexloads],
    Reset=reset,
    Threshold=1e-15,
    Tolerance=0.01,
    On=True)  # -> I, V, O
data = Data(solver.O)

# ==== cluster Corners: Find the boundary corner points of a quad mesh
mesh = ClusterInput()
mesh_2 = Mesh(mesh)
nv = NakedVertices(Mesh=mesh_2)  # -> ClothedIndex, NakedIndex, ClothedPts, NakedPts
vn = VertexNeighbours(Mesh=mesh_2, VertexNumber=nv.NakedIndex)  # -> graft(Vertex), Neighbours, Normal
lng = ListLength(List=vn.Neighbours)
equals = Equality(FirstNumber=lng, SecondNumber=3)  # -> Equality, Inequality
cull = CullPattern(List=vn.Vertex, CullPattern=equals.Inequality)
pshift = ShiftPaths(Data=cull, Offset=-1)
D = ClusterOutput(pshift)
