# Grasshopper definition Collide2d_shapes.gh (Grasshopper 0.9.76)
# plug-ins: Kangaroo2 Components

C = Curve([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])
explode = Explode(Curve=C, Recursive=True)  # -> Segments, Vertices
shift = ShiftList(List=explode.Segments, Shift=1, Wrap=False)
angle = Angle(LineA=explode.Segments, LineB=shift, Strength=10)
c2d = Collide2d(Polylines=C, Plane=PlaneXY(0, 0, 0), Strength=1)
length_line = LengthLine(Line=explode.Segments, Strength=10)
grab = Grab(On=True, Strength=1, Range=3)  # -> Grab, Anchors
solver = Solver(GoalObjects=[angle, length_line, c2d, grab.Grab], Reset=Button(), Threshold=1e-15, Tolerance=0.01, On=True)  # -> I, V, O
data = Data(solver.O)
