# Grasshopper definition chain_collider.gh (Grasshopper 1.0.8)

crv = Curve([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])
divide = DivideCurve(Curve=crv, Count=10, Kinks=False)  # -> Points, Tangents, Parameters
rigidpointset = RigidPointSet(Points=divide.Points, Strength=10)  # -> RigidBody, Planes
pline = PolyLine(Vertices=divide.Points, Closed=True)
explode = Explode(Curve=pline, Recursive=True)  # -> Segments, Vertices
line = Line(explode.Segments)
collider = Collider(Objects=flatten(line), Radii="2", Strength=10)
grab = Grab(On=True, Strength=1, Range=3)
show = Show(G=pline)
entwine = Entwine(Branch00=show, Branch01=[collider, grab, rigidpointset.RigidBody], FlattenInputs=True)
solver = Solver(GoalObjects=entwine, Reset=Button(), Threshold=1e-15, Tolerance=0.01, On=True)  # -> I, V, O
bang = ExplodeTree(Data=solver.O)  # -> Branch0, Branch1
explode_2 = Explode(Curve=bang.Branch0, Recursive=True)  # -> Segments, Vertices
end = EndPoints(Curve=explode_2.Segments)  # -> Start, End
intcrv = Interpolate(Vertices=end.Start, Degree=3, Periodic=True, KnotStyle=1)  # -> Curve, Length, Domain
pipe = Pipe(Curve=intcrv.Curve, Radius="2", Caps=0)
preview = CustomPreview(
    Geometry=pipe,
    Material={diffuse=RGB(255, 215, 0), emission=RGB(0, 0, 0), shine=0.9, specular=RGB(255, 255, 255), transparency=0})
