# Grasshopper definition cloth_inflatable_collision.gh (Grasshopper 0.9.76)
# plug-ins: Kangaroo Components, Kangaroo2 Components

mesh = Mesh(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)
mesh_2 = Mesh(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)
tri = Triangulate(Mesh=mesh)  # -> Mesh, Count
tri_2 = Triangulate(Mesh=mesh_2)  # -> Mesh, Count
clean = CombineClean(Meshes=tri.Mesh)
demesh = DeconstructMesh(Mesh=tri_2.Mesh)  # -> Vertices, Faces, Colours, Normals
show = Show(G=[clean, tri_2.Mesh])

# ---- group: preserving volume, and decreasing edge lengths for balloon
medges = MeshEdges(Mesh=clean)  # -> NakedEdges, InteriorEdges, NonManifoldEdges
volume = Volume(Mesh=clean, Strength=0.1)
length_line = LengthLine(Line=medges.InteriorEdges, Length=0, Strength=0.1)

# ----
medges_2 = MeshEdges(Mesh=tri_2.Mesh)  # -> NakedEdges, InteriorEdges, NonManifoldEdges
Z = UnitZ(Factor=-0.1)

# ---- group: cloth self-collision using spheres
sc = SphereCollide(Points=demesh.Vertices, Radius=1.7, Strength=1)

# ---- group: 2-way collision between balloon and cloth
spc = SolidPointCollide(Points=demesh.Vertices, Solid=clean, Interior=False, Unidirectional=False, Strength=1)

# ----
load = Load(Point=demesh.Vertices, ForceVector=Z)
floor = Floor(Strength=1)
grab = Grab(On=True, Strength=1, Range=3)  # -> Grab, Anchors
length_line_2 = LengthLine(Line=[medges_2.InteriorEdges, medges_2.NakedEdges], Strength=10)
solver = Solver(
    GoalObjects=[length_line_2, load, floor, volume, show, spc, length_line, sc, grab.Grab],
    Reset=Button(),
    Threshold=1e-15,
    Tolerance=0.01,
    On=Toggle(True))  # -> I, V, O
data = Data(solver.O)
