# Grasshopper definition clothcollide.gh (Grasshopper 1.0.4)
# plug-ins: Weaverbird, Kangaroo2 Components

mplane = MeshPlane(Boundary={Plane=PlaneXY(0, 0, 0), Size=Domain2(u=-10..10, v=-10..10)}, WidthCount=10, HeightCount=10)  # -> Mesh, Area
demesh = DeconstructMesh(Mesh=mplane.Mesh)  # -> Vertices, Faces, Colours, Normals
edgelengths = EdgeLengths(Mesh=mplane.Mesh, LengthFactor=1, Strength=1)
show = Show(G=mplane.Mesh)
sc = SphereCollide(Points=demesh.Vertices, Radius=1, Strength=1)
grab = Grab(On=True, Strength=1, Range=3)  # -> Grab, Anchors
solver = Solver(GoalObjects=[sc, grab.Grab, show, edgelengths], Reset=Button(), Threshold=1e-15, Tolerance=0.01, On=True)  # -> I, V, O
data = Data(solver.O)
# This definition uses the Weaverbird
# plugin to further subdivide the output
# from Kangaroo
wbcatmullclark = WeaverbirdsCatmullClarkSubdivision(MeshCurves=data, Level=3, SmoothNakedEdges=2)
