# Grasshopper definition collide_simple.gh (Grasshopper 0.9.76)
# plug-ins: Kangaroo2 Components

crv = Curve(<curve referenced from the Rhino model>)
addition = Addition(A="3", B="3")
grab = Grab(On=True, Strength=1, Range=3)  # -> Grab, Anchors
clamplength = ClampLength(Line=crv, LowerLimit=addition, UpperLimit=10, Strength=1)
solver = Solver(GoalObjects=[clamplength, grab.Grab], Reset=False, Threshold=1e-15, Tolerance=0.01, On=True)  # -> I, V, O
cir = Circle(Plane=solver.V, Radius="3")
