# Grasshopper definition floorcollide.gh (Grasshopper 1.0.8)

pop3d = Populate3D(
    Region={Plane=Plane(origin=(5, 4, 0), x=(0, 1, 0), y=(1, 0, 0)), X=Domain(0, 17), Y=Domain(0, 18), Z=Domain(-16, 0)},
    Count=500,
    Seed=1)
Z = UnitZ(Factor=-0.1)
button = Button()
floor = Floor(Strength=1)
sc = SphereCollide(Points=pop3d, Radius="1", Strength=1)
toggle = BooleanToggle(False)
load = Load(Point=pop3d, ForceVector=Z)
grab = Grab(On=True, Strength=1, Range=3)
solver = Solver(Reset=button, Threshold=1e-15, Tolerance=0.01, On=toggle)  # -> I, V, O; disabled
bouncysolver = BouncySolver(GoalObjects=[sc, load, floor, grab], Reset=button, Threshold=1e-15, Tolerance=0.01, Damping=1, Iterations=10, On=toggle)  # -> I, V, O
msphere = MeshSphere(Base=bouncysolver.V, Radius="1", UCount=4, VCount=8)
