# Grasshopper definition multiradius_sphere_line_collide.gh (Grasshopper 1.0.4)
# plug-ins: Kangaroo2 Components

crv = Curve(<curve referenced from the Rhino model>)
panel = Panel("""1
2
3""")
pt = Point([Point(18, 26, 0), Point(32, 16, 0)])
line = Line(crv)
grab = Grab(On=True, Strength=1, Range=3)  # -> Grab, Anchors
collider = Collider(Objects=[pt, line], Radii=panel, Strength=1)
length_line = LengthLine(Line=line, Strength=10)
show = Show(G=pt)
entwine = Entwine(Branch00=[collider, grab.Grab], Branch01=length_line, Branch02=show, FlattenInputs=True)
solver = Solver(GoalObjects=entwine, Reset=Button(), Threshold=1e-15, Tolerance=0.01, On=True)  # -> I, V, O
bang = ExplodeTree(Data=solver.O)  # -> Branch0, Branch1, Branch2
pipe = Pipe(Curve=bang.Branch1, Radius=3, Caps=2)
sph = Sphere(Base=bang.Branch2, Radius=[1, 2])
