# Grasshopper definition rigid_mesh_collision.gh (Grasshopper 1.0.8)

brep = Brep([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])
jagged = SettingsSpeed()
mesh = MeshBrep(Brep=brep, Settings=jagged)
crossref = CrossReference(ListA=mesh, ListB=mesh, CrossMode=5)  # -> graft(ListA), graft(ListB)
demesh = DeconstructMesh(Mesh=mesh)  # -> Vertices, Faces, Colours, Normals
mesh_2 = Mesh([crossref.ListA, crossref.ListB])
cullpt = CullDuplicates(Points=demesh.Vertices, Tolerance=0.1, CullMode=3)  # -> Points, Indices, Valence
item = ListItem(List=mesh_2, Index=0, Wrap=True)  # -> Item, Item1
solidplanecollide = SolidPlaneCollide(Solid=mesh, CollisionPlane=PlaneXY(0, 0, 0), Strength=3)
rigidbody = RigidBody(Part=graft(mesh), Points=cullpt.Points, Strength=6)  # -> RigidBody, Planes
solidcollide = SolidCollide(MeshA=item.Item, MeshB=item.Item1, Strength=1)
grab = Grab(On=True, Strength=1, Range=3)
pt = Point(flatten(rigidbody.Planes))
Z = UnitZ(Factor=-0.03)
load = Load(Point=pt, ForceVector=Z)

reset = Button()
run = BooleanToggle(True)

solver_bouncy = SolverBouncy(
    GoalObjects=[load, solidplanecollide, rigidbody.RigidBody, solidcollide, grab],
    Reset=reset,
    Threshold=1e-08,
    Tolerance=0.01,
    Damping=0.99,
    Iterations=25,
    On=run)  # -> I, V, O
medges = MeshEdges(Mesh=solver_bouncy.O)  # -> NakedEdges, InteriorEdges, NonManifoldEdges
mesh_3 = Mesh(solver_bouncy.O)
colourful = Colourful(geo=mesh_3)

# ==== cluster Colourful: Display objects in bright colours
geo = ClusterInput()
geo_2 = Geometry(geo)
clean = CleanTree(RemoveNulls=True, RemoveInvalid=True, RemoveEmpty=False, Tree=flatten(geo_2))
S = Shader([{diffuse=RGB(11, 125, 222), emission=RGB(3, 38, 67), shine=0.5, specular=RGB(255, 255, 255), transparency=0}, {diffuse=RGB(222, 37, 11), emission=RGB(67, 11, 3), shine=0.5, specular=RGB(255, 255, 255), transparency=0}, {diffuse=RGB(71, 222, 11), emission=RGB(21, 67, 3), shine=0.5, specular=RGB(255, 255, 255), transparency=0}, {diffuse=RGB(222, 194, 11), emission=RGB(67, 58, 3), shine=0.5, specular=RGB(255, 255, 255), transparency=0}])
lng = ListLength(List=clean)
repeat = RepeatData(Data=S, Length=lng)
preview = CustomPreview(Geometry=clean, Shader=repeat)
