# Grasshopper definition solidParticleCollide.gh (Grasshopper 0.9.76)
# plug-ins: Kangaroo2 Components

pop3d = Populate3D(Region={Plane=PlaneXY(-7, -7, 0), X=Domain(0, 27), Y=Domain(0, 30), Z=Domain(0, 23)}, Count=100, Seed=1)
brep = Brep(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)
Y = UnitY(Factor=-0.01)
Z = UnitZ(Factor=-0.01)
spc = SolidPointCollide(Points=pop3d, Solid=brep, Interior=False, Unidirectional=Toggle(True), Strength=1)
reset = Button()
on = BooleanToggle(False)
sc = SphereCollide(Points=pop3d, Radius=1, Strength=10)
load = Load(Point=pop3d, ForceVector=Z)
solver = Solver(GoalObjects=[sc, load, spc], Reset=reset, Threshold=1e-15, Tolerance=0.01, On=on)  # -> I, V, O
cloud = CloudDisplay(Points=solver.V, Colours=RGB(35, 55, 186), Size=1.1, SpriteType=1)
