# Grasshopper definition Circular_mesh.gh (Grasshopper 1.0.4)
# plug-ins: Kangaroo2 Components

# ---- group: The planarity and circularity strength can be ramped up to enforce a hard constraint
_10º = PowerOf10(Value=Slider(0, range=0..10))

# ----
mesh = Mesh(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)
srf = Surface(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)
demesh = DeconstructMesh(Mesh=mesh)  # -> Vertices, Faces, Colours, Normals
edgelengths = EdgeLengths(Mesh=mesh, LengthFactor=1, Strength=0.01)
grab = Grab(On=True, Strength=1, Range=3)  # -> Grab, Anchors
planarize = Planarize(M=mesh, Strength=_10º)
cyclicquad = CyclicQuad(M=mesh, Strength=_10º)
onmesh = OnMesh(Points=demesh.Vertices, Mesh=srf, Strength=1)
smooth = Smooth(M=mesh, Strength=1)
show = Show(G=mesh)
solver = Solver(
    GoalObjects=[grab.Grab, show, planarize, smooth, onmesh, cyclicquad, edgelengths],
    Reset=Button(),
    Threshold=1e-15,
    Tolerance=0.01,
    On=Toggle(True))  # -> I, V, O
bang = ExplodeTree(Data=solver.O)  # -> Branch0, Branch1
mesh_2 = Mesh(bang.Branch0)
medges = MeshEdges(Mesh=mesh_2)  # -> NakedEdges, InteriorEdges, NonManifoldEdges
tri = Triangulate(Mesh=mesh_2)  # -> Mesh, Count
facec = FaceCircles(Mesh=tri.Mesh)  # -> Centers, Ratio
