# Grasshopper definition british_museum.gh (Grasshopper 0.9.76)
# plug-ins: Kangaroo2 Components

mesh = Mesh(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)
medges = MeshEdges(Mesh=mesh)  # -> NakedEdges, InteriorEdges, NonManifoldEdges
demesh = DeconstructMesh(Mesh=mesh)  # -> Vertices, Faces, Colours, Normals
join = JoinCurves(Curves=medges.NakedEdges, Preserve=False)
brep = Brep(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)
item = ListItem(List=join, Index=0, Wrap=True)  # -> Item, Item1
show = Show(G=mesh)
onmesh = OnMesh(Points=demesh.Vertices, Mesh=brep, Strength=1)
crv = Curve(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)
crv_2 = Curve(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)
mc = MeshCorners(Mesh=mesh, Angle=2.35619449)
length_line = LengthLine(Line=[medges.InteriorEdges, medges.NakedEdges], Length=0, Strength=0.1)
explode = Explode(Curve=item.Item, Recursive=True)  # -> Segments, Vertices
explode_2 = Explode(Curve=item.Item1, Recursive=True)  # -> Segments, Vertices
anchor = Anchor(Point=mc, Strength=10000)
end = EndPoints(Curve=explode_2.Segments)  # -> Start, End
strength = Strength(1000)
end_2 = EndPoints(Curve=explode.Segments)  # -> Start, End
oncurve = OnCurve(Points=end_2.Start, Curve=crv, Strength=strength)
oncurve_2 = OnCurve(Points=end.Start, Curve=crv_2, Strength=strength)
solver = Solver(
    GoalObjects=[show, oncurve_2, oncurve, anchor, length_line, onmesh],
    Reset=Button(),
    Threshold=1e-15,
    Tolerance=0.01,
    On=Toggle(False))  # -> I, V, O
item_2 = ListItem(List=solver.O, Index=0, Wrap=True)
