# Grasshopper definition equalize.gh (Grasshopper 1.0.8)

mesh = Mesh(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)
tri = Triangulate(Mesh=mesh)  # -> Mesh, Count
demesh = DeconstructMesh(Mesh=mesh)  # -> Vertices, Faces, Colours, Normals
xz = XZPlane(Origin=Point(0, 0, 0))
medges = MeshEdges(Mesh=tri.Mesh)  # -> NakedEdges, InteriorEdges, NonManifoldEdges
faceb = FaceBoundaries(Mesh=tri.Mesh)
P = Point([Point(5, 0, 5), Point(5, 0, 15)])
explode = Explode(Curve=faceb, Recursive=True)  # -> Segments, Vertices
crv = Curve([medges.NakedEdges, medges.InteriorEdges])
grab = Grab(On=True, Strength=1, Range=3)
anchor = Anchor(Point=P, Strength=1000)
equallength = EqualLength(Line=explode.Segments, Strength=1)
onplane = OnPlane(Points=demesh.Vertices, Plane=xz, Strength=1)
show = Show(G=crv)
solver = Solver(GoalObjects=[show, equallength, onplane, anchor, grab], Reset=Button(), Threshold=1e-15, Tolerance=0.01, On=Toggle(True))  # -> I, V, O
data = Data(solver.O)
