# Grasshopper definition inflation.gh (Grasshopper 0.9.76)
# plug-ins: Kangaroo2 Components

W = WidthCount(6)
mbox = MeshBox(Base={Plane=PlaneXY(0, 0, 0), X=Domain(-10, 10), Y=Domain(-10, 10), Z=Domain(-10, 10)}, XCount=W, YCount=W, ZCount=W)
tri = Triangulate(Mesh=mbox)  # -> Mesh, Count
mesh = Mesh(tri.Mesh)
clean = CombineClean(Meshes=mesh)
medges = MeshEdges(Mesh=clean)  # -> NakedEdges, InteriorEdges, NonManifoldEdges
grab = Grab(On=True, Strength=1, Range=3)  # -> Grab, Anchors
pressure = Pressure(M=clean, Strength=0.01)
length_line = LengthLine(Line=medges.InteriorEdges, Strength=5)
show = Show(G=clean)
solver = Solver(GoalObjects=[length_line, pressure, show, grab.Grab], Reset=Button(), Threshold=1e-15, Tolerance=0.01, On=Toggle(True))  # -> I, V, O
data = Data(solver.O)
