# Grasshopper definition strandbeest.gh (Grasshopper 1.0.8)

crv = Curve([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])
pt = Point([Point(38.37953562, 63.10049538, 0), Point(63.35407149, 63.10049538, 0)])
pt_2 = Point(Point(45.96265117, 65.74097308, 0))
O = Origin(Point(50.86680355, 65.74098193, 0))
knob = ControlKnob(Decimals=2, Limit=False, Maximum=10, Minimum=0, Range=6.28, Value=0.07)
xy = XYPlane(Origin=O)
rotate = Rotate(Geometry=pt_2, Angle=expr("-x", knob), Plane=xy)  # -> Geometry, Transform
length_line = LengthLine(Line=crv, Strength=1)
anchor = Anchor(Point=[pt, O], Strength=10000)
anchor_2 = Anchor(Point=pt_2, Target=rotate.Geometry, Strength=1)
solver = Solver(GoalObjects=[length_line, anchor, anchor_2], Reset=Button(), Threshold=1e-15, Tolerance=0.01, On=Toggle(True))  # -> I, V, O
item = ListItem(List=solver.V, Index=[3, 11], Wrap=True)
rec = DataRecorder(item, DataLimit=-10, RecordData=True)
