# Grasshopper definition hyperbolic.gh (Grasshopper 1.0.8)

mesh = Mesh(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)
R = Radius(1)
demesh = DeconstructMesh(Mesh=mesh)  # -> Vertices, Faces, Colours, Normals
medges = MeshEdges(Mesh=mesh)  # -> NakedEdges, InteriorEdges, NonManifoldEdges
crv = Curve([medges.NakedEdges, medges.InteriorEdges])

# ---- group: reduce slider to 0 to make all edges same length
number_slider = Slider(1, range=0..1)

# ----
len = Length(Curve=crv)
addition = Addition(A=R, B=R)
simulate = BooleanToggle(True)
reset = Button()
subtraction = Subtraction(A=len, B=addition)
multiplication = Multiplication(A=subtraction, B=number_slider)
addition_2 = Addition(A=multiplication, B=addition)
sc = SphereCollide(Points=demesh.Vertices, Radius=R, Strength=1)
grab = Grab(On=True, Strength=1, Range=3)
smooth = Smooth(M=mesh, Strength=1)
length_line = LengthLine(Line=crv, Length=addition_2, Strength=1000)
show = Show(G=mesh)
solver = Solver(GoalObjects=[length_line, smooth, show, sc, grab], Reset=reset, Threshold=1e-10, Tolerance=0.01, On=simulate)  # -> I, V, O
