# Grasshopper definition polygonassemble.gh (Grasshopper 1.0.8)

mesh = Mesh([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])
medges = MeshEdges(Mesh=mesh)  # -> NakedEdges, InteriorEdges, NonManifoldEdges
show = Show(G=mesh)
grab = Grab(On=True, Strength=1, Range=3)
demesh = DeconstructMesh(Mesh=mesh)  # -> Vertices, Faces, Colours, Normals
length_line = LengthLine(Line=medges.NakedEdges, Strength=100)
ms = MagnetSnap(Points=flatten(demesh.Vertices), Range=Slider(2.5, range=0..3), Strength=10)
solver = Solver(GoalObjects=[length_line, ms, show, grab], Reset=Button(), Threshold=1e-15, Tolerance=0.01, On=True)  # -> I, V, O
data = Data(solver.O)
