# Grasshopper definition SoapFilm.gh (Grasshopper 1.0.8)

mesh = Mesh(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)
tri = Triangulate(Mesh=mesh)  # -> Mesh, Count
nv = NakedVertices(Mesh=mesh)  # -> ClothedIndex, NakedIndex, ClothedPts, NakedPts
tsmooth = TangentialSmooth(M=mesh, Strength=10)
sg = SoapFilm(Mesh=tri.Mesh, Strength=1)
anchor = Anchor(Point=nv.NakedPts, Strength=1000)
show = Show(G=tri.Mesh)
solver = Solver(GoalObjects=[show, anchor, tsmooth, sg], Reset=Button(), Threshold=1e-15, Tolerance=0.01, On=True)  # -> I, V, O
data = Data(solver.O)
